# Grasshopper definition mmObjectExport.ghx (Grasshopper 0.9.76)

geo = Geometry(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)
geo_2 = Geometry(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)
mesh = Mesh()
mesh_2 = Mesh()
collection = CSharpScript(geometry=mesh, name="FLOOR_1_WALLS")  # -> out, A; inputs geometry: list of GeometryBase, name: String
# ---------- collection: C# ----------
    foreach(GeometryBase geo in geometry) {
      geo.SetUserString("collection", name);
    }
    A = geometry;
# ---------- end collection ----------
collection_2 = CSharpScript(geometry=mesh_2, name="FLOOR_0_WALLS")  # -> out, A; inputs geometry: list of GeometryBase, name: String; same code as collection

geo_3 = Geometry([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])
geo_4 = Geometry([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])
mesh_3 = Mesh()
mesh_4 = Mesh()
collection_3 = CSharpScript(geometry=mesh_3, name="FLOOR_0")  # -> out, A; inputs geometry: list of GeometryBase, name: String; same code as collection
collection_4 = CSharpScript(geometry=mesh_4, name="FLOOR_1")  # -> out, A; inputs geometry: list of GeometryBase, name: String; same code as collection

geo_5 = Geometry([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])
geo_6 = Geometry(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)
mesh_5 = Mesh()
mesh_6 = Mesh()
journey = CSharpScript(agentNum="100", simTime="10 to 90")  # -> out, A; inputs startPortals: list, agentNum: String
# ---------- journey: C# ----------
    Attribute _temp = new Attribute("Attributes");
    
    _temp.AddAttribute("AttrEventMultiOrigin", "", "");
    _temp.Attributes["AttrEventMultiOrigin"].AddNestedAttribute("Data", new List < List < string >> {
        new List < string > {"GlobalIDs", "[]", "3"},
        new List < string > {"WeightedType", "WeightedNone", "3"},
        new List < string > {"Weights", "[]", "2"}
        });
    _temp.Attributes["AttrEventMultiOrigin"].AddAttribute("Type", "DataTypeVectorWeightedGlobalID", "3");
    
    _temp.AddNestedAttribute("AttrEventPopulation", new List < List < string >> {
        new List < string > {"Data", agentNum, "1"},
        new List < string > {"Type", "DataTypeInt", "3"}
        });

    _temp.AddAttribute("AttrEventStartTime", "", ""); // cannot add optional parameters
    _temp.Attributes["AttrEventStartTime"].AddNestedAttribute("Data", new List < List < string >> {
        new List < string > {"GlobalID", "00000000-0000-0000-0000-000000000000", "3"},
        new List < string > {"TimeInSeconds", TimeInSeconds(simTime[0]), "3"},
        new List < string > {"TimeType", "TimeSimulationStart", "3"}
        });
    _temp.Attributes["AttrEventStartTime"].AddAttribute("Type", "DataTypeTimeReference", "3");
 


    A = _temp.ToString();
# ---------- journey: C# additional code ----------
  private string TimeInSeconds (double num)
  {
    List <string> timeInSeconds = new List<string> { "00","00","00" };
    timeInSeconds[0] = NumToTimeString(Math.Floor(num / 60));
    timeInSeconds[1] = NumToTimeString(num % 60);
    return String.Join(":", timeInSeconds.ToArray());
  }

  private string NumToTimeString(double num)
  {
    if ( num.ToString().Length < 2 ) {
      return "0" + num.ToString();
    } else {
      return num.ToString();
    }
  }


  private class Attribute
  {
    private string _name;
    private string _v;
    private string _t;
    private Dictionary<string, Attribute> _attr = new Dictionary<string, Attribute>();

    public Attribute(string name)
    {
      this._name = name;
    }
    public string Name {get { return this._name; }}
    public string V {
      get { return this._v; }
      set { this._v = value; }
    }
    public string T {
      get { return this._t; }
      set { this._t = value; }
    }
    public Dictionary<string, Attribute> Attributes {get { return this._attr; }}

    
    public void AddAttribute(string name, string v, string t)
    {
      var attr = new Attribute(name);
      this._attr.Add(name, attr);
      if ( v != "") { attr.V = v; }
      if ( t != "") { attr.T = t; }
    }
    
    // this could probably be made recursive
    public void AddNestedAttribute(string name, List<List<string>> subAttr)
    {
      this.AddAttribute(name, "", "");
      foreach (List<string> attr in subAttr)
      {
        this.Attributes[name].AddAttribute(attr[0], attr[1], attr[2]);
      }
    }

    public override string ToString(){
      string parsed = "<" + this.Name.ToString();

      if (this.V != null){
        parsed += " v=" + "\"" + this.V + "\" ";
      }
      if (this.T != null){
        parsed += " t=" + "\"" + this.T + "\" ";
      }
      parsed += ">";

      foreach (string key in this.Attributes.Keys){
        parsed += this.Attributes[key].ToString();
      }

      return parsed + "</" + this.Name.ToString() + ">";
    }
  }
# ---------- end journey ----------
panel = Panel(journey.A)
mass_motion_export = CSharpScript(
    floors=[collection_4.A, collection_3.A],
    barriers=[collection_2.A, collection.A],
    links=mesh_5,
    portals=mesh_6,
    filePath="C:\My Documents\_TEMP\Rhino\Grasshopper\MassMotion\test",
    fileName="rhino_export",
    run=Toggle(False))  # -> out, A; inputs floors: tree of Mesh, barriers: tree of Mesh, paths: tree of Polyline, links: tree of Mesh, portals: tree of Mesh, geometry: tree of Mesh, filePath: String, fileName: String, run: Boolean
# ---------- mass_motion_export: C# ----------
                                    /*                                                                                                                                                                                                                    /*
     * Script written by <Luis Jaggy>
     * Script version <3 March 2016>
     */

    List<Rhino.Geometry.Mesh> floorList = floors.AllData();
    List<Rhino.Geometry.Mesh> barrierList = barriers.AllData();
    List<Rhino.Geometry.Polyline> pathList = paths.AllData();
    List<Rhino.Geometry.Mesh> linkList = links.AllData();
    List<Rhino.Geometry.Mesh> portalList = portals.AllData();
    List<Rhino.Geometry.Mesh> geometryList = geometry.AllData();

    Dictionary<string, List<string>> collections = new Dictionary<string, List<string>>();
    Dictionary<string, List<string>> journeys = new Dictionary<string, List<string>>();

    if (run && fileName != null)
    {
      string pathString = System.IO.Path.Combine(filePath, "gh_out");
      System.IO.Directory.CreateDirectory(pathString);
      string path = pathString + "//" + fileName + ".mmxml";

      using (FileStream filestream = new FileStream(path, FileMode.Create))
      using (StreamWriter sw = new StreamWriter(filestream))
      using (XmlTextWriter writer = new XmlTextWriter(sw))
      {
        writer.Formatting = Formatting.Indented;
        writer.Indentation = 4;

        writer.WriteStartDocument();
        writer.WriteComment("Script written by <Luis Jaggy>");
        writer.WriteStartElement("DataRoot");
        writer.WriteAttributeString("FormatVersion", "1");
        writer.WriteAttributeString("ContentVersion", "8.0.9.0");
        writer.WriteAttributeString("FileName", "");

        writer.WriteStartElement("Objects");

        for (int i = 0; i < portalList.Count; i++)
        {
          MMPortal mmPortal = new MMPortal(portalList[i], writer, i.ToString());
          AddOrUpdateDict(portalList[i], "collection", mmPortal.GlobalID, collections);
          mmPortal.Write();
        }

        for (int i = 0; i < linkList.Count; i++)
        {
          MMLink mmLink = new MMLink(linkList[i], writer, i.ToString());
          AddOrUpdateDict(linkList[i], "collection", mmLink.GlobalID, collections);
          mmLink.Write();
        }
        for (int i = 0; i < pathList.Count; i++)
        {
          MMPath mmPath = new MMPath(pathList[i], writer, i.ToString());
          mmPath.Write();
        }
        for (int i = 0; i < barrierList.Count; i++)
        {
          MMBarrier mmBarrier = new MMBarrier(barrierList[i], writer, i.ToString());
          AddOrUpdateDict(barrierList[i], "collection", mmBarrier.GlobalID, collections);
          mmBarrier.Write();
        }
        for (int i = 0; i < floorList.Count; i++)
        {
          MMFloor mmFloor = new MMFloor(floorList[i], writer, i.ToString());
          AddOrUpdateDict(floorList[i], "collection", mmFloor.GlobalID, collections);
          mmFloor.Write();
        }
        for (int i = 0; i < geometryList.Count; i++)
        {
          MMVisOnly mmVisOnly = new MMVisOnly(geometryList[i], writer, i.ToString());
          mmVisOnly.Write();
        }
        foreach(string key in collections.Keys)
        {
          MMCollection mmCollection = new MMCollection(collections[key], writer, key);
          mmCollection.Write();
        }

        writer.WriteEndElement();
        writer.WriteStartElement("Settings");
        writer.WriteElementString("Attributes", " ");
        writer.WriteEndElement();

        writer.WriteEndElement();
        writer.WriteEndDocument();

        //System.Diagnostics.Process.Start("explorer.exe", pathString);

      }
    }
# ---------- mass_motion_export: C# additional code ----------
  /*
  * Utiliy methods
  */

  public void AddOrUpdateDict(Rhino.Geometry.GeometryBase geo, string key, string val, Dictionary<string, List<string>> dict)
  {
    var userStrings = geo.GetUserStrings();
    if (userStrings.AllKeys.Contains(key)){
      var name = userStrings[key];
      if (dict.ContainsKey(name)) {
        dict[name].Add(val);
      } else {
        List<string> lst = new List<string>();
        lst.Add(val);
        dict.Add(name, lst);

      }
    }
  }

  /*
   * * * * *
   * MassMotionObject SuperClass that handles geometry conversion to Xml
   */
  abstract class MMObject
  {
    public XmlTextWriter _Writer;
    public string _GlobalID;
    public string _ID;
    public string _Name;
    public string _ObjectSubType;
    public string _ObjectType = "Actor";

    // constructor method
    public MMObject(XmlTextWriter writer, string tag)
    {
      this._ID = "_temp" + tag;
      this._GlobalID = Guid.NewGuid().ToString();
      this._Writer = writer;
    }

    public string Name { get { return this._Name; }}
    public XmlTextWriter Writer { get { return this._Writer; }}
    public string GlobalID { get { return this._GlobalID; }}
    public string ID {get { return this._ID; }}
    public string ObjectSubType { get { return this._ObjectSubType; }}
    public string ObjectType { get { return this._ObjectType; }}

    // Write this Geometry's attributes to Xml
    public void Write()
    {
      this.Writer.WriteStartElement(this.Name);

      WriteAttributes();
      WriteBody();
      WriteProperty("GlobalID", this.GlobalID, 3);
      WriteProperty("ID", this.ID, 1);
      WriteProperty("Name", this.Name, 3);
      WriteProperty("ObjectSubType", this.ObjectSubType, 3);
      WriteProperty("ObjectType", this.ObjectType, 3);

      this.Writer.WriteEndElement();
    }

    // Write the attributes element of this object
    public virtual void WriteAttributes()
    {
      this.Writer.WriteElementString("Attributes", " ");
    }

    // Write the body element of this object
    // this method can probably be removed
    public virtual void WriteBody()
    {
      this.Writer.WriteStartElement("Body");
      this.Writer.WriteElementString("Attributes", " ");
      this.Writer.WriteElementString("Geometry", " ");
      this.Writer.WriteEndElement();
    }

    // method to write a generic property to the xml file
    public void WriteProperty(string property, string val, int t)
    {
      this.Writer.WriteStartElement(property);
      this.Writer.WriteAttributeString("v", val);
      this.Writer.WriteAttributeString("t", t.ToString());
      this.Writer.WriteEndElement();
    }

    // method to write an object attribute to the xml file
    public void WriteAttribute(string attr, string data, int datat, string type, int typet)
    {
      this.Writer.WriteStartElement(attr);
      WriteProperty("Data", data, datat);
      WriteProperty("Type", type, typet);
      this.Writer.WriteEndElement();
    }

    // method to write the geometry element of a mesh
    public void WriteMeshGeometry(Rhino.Geometry.Mesh msh)
    {
      this.Writer.WriteStartElement("Geometry");
      WriteProperty("Faces", SerializeMeshFaces(msh), 1);
      WriteProperty("GeometryType", "MeshGeometry", 3);
      WriteProperty("Vertices", SerializeMeshVertices(msh), 2);
      this.Writer.WriteEndElement();
    }

    // method to write the geometry element of a polyline
    public void WritePolyLineGeometry(Rhino.Geometry.Polyline pline)
    {
      this.Writer.WriteStartElement("Geometry")
        ;
      this.Writer.WriteStartElement("CurveData");
      this.WriteProperty("RawPoints", SerializePolylineVertices(pline), 2);
      this.Writer.WriteEndElement();

      this.WriteProperty("EdgeRadius", "0.050000", 2);
      this.WriteProperty("GeometryType", "PolylineGeometry", 3);
      this.WriteProperty("VertexRadius", "0.100000", 2);
      this.Writer.WriteEndElement();
    }

    // Returns a string of serialized mesh faces (flattened)
    public string SerializeMeshFaces(Rhino.Geometry.Mesh msh)
    {
      string serialized = "[]";
      List<string> faces = new List<string>();

      msh.Vertices.CombineIdentical(false, false);

      foreach (Rhino.Geometry.MeshFace face in msh.Faces){
        faces.Add(face.A.ToString());
        faces.Add(face.B.ToString());
        faces.Add(face.C.ToString());
        if (face.IsQuad) {
          faces.Add(face.A.ToString());
          faces.Add(face.C.ToString());
          faces.Add(face.D.ToString());
        }
      }
      return serialized.Insert(1, String.Join(",", faces.ToArray()));
    }

    // Returns a string of serialized mesh vertices (flattened)
    public string SerializeMeshVertices(Rhino.Geometry.Mesh msh)
    {
      string serialized = "[]";
      List<string> coords = new List<string>();

      foreach (Rhino.Geometry.Point3d pt in msh.Vertices){
        coords.Add(pt.X.ToString());
        coords.Add(pt.Z.ToString());
        coords.Add((-pt.Y).ToString());
      }
      return serialized.Insert(1, String.Join(",", coords.ToArray()));
    }

    // Returns a string of serialized polyline vertices (flattened)
    public string SerializePolylineVertices(Rhino.Geometry.Polyline pline)
    {
      string serialized = "[]";
      List<string> coords = new List<string>();

      foreach (Rhino.Geometry.Point3d pt in pline){
        coords.Add(pt.X.ToString());
        coords.Add(pt.Z.ToString());
        coords.Add((-pt.Y).ToString());
      }
      return serialized.Insert(1, String.Join(",", coords.ToArray()));
    }

    // Returns a string of serialized list items
    public string SerializeList<T>(List<T> lst)
    {
      string serialized = "[]";
      List<string> serializedList = new List<string>();

      foreach( var item in lst) {
        serializedList.Add(item.ToString());
      }
      return serialized.Insert(1, String.Join(",", serializedList.ToArray()));
    }

    // ## not working
    public string SerializeMeshEdges(Rhino.Geometry.Mesh msh)
    {
      string serialized = "[]";
      return serialized;
    }

    // Returns a joined mesh from a list of meshes
    public Mesh JoinMeshes(List<Mesh> meshes)
    {
      var msh = new Rhino.Geometry.Mesh();
      foreach(Rhino.Geometry.Mesh m in meshes)
      {
        msh.Append(m);
      }
      return msh;
    }
  }


  /*
   * MassMotionCollection Class
   */
  class MMCollection : MMObject
  {

    List<string> _IDs;

    public MMCollection(List<string> ids, XmlTextWriter writer, string tag)
      : base(writer, tag)
    {
      this._ObjectSubType = "GroupCollection";
      this._ObjectType = "Group";
      this._Name = tag;
      this._IDs = ids;
    }

    public List<string> IDs {get {return this._IDs; }}

    public override void WriteAttributes()
    {

      List<float> averages = new List<float>();
      int count = this.IDs.Count;
      for (int i = 0; i < count; i++)
      {
        float average = (1F / count);
        averages.Add(average);
      }

      this.Writer.WriteStartElement("Attributes");
      this.Writer.WriteStartElement("AttrCollectionBaseMembers");
      this.Writer.WriteStartElement("Data");
      this.WriteProperty("GlobalIDs", this.SerializeList(this.IDs), 3);
      this.WriteProperty("WeightedType", "WeightedNone", 3);
      this.WriteProperty("Weights", this.SerializeList(averages), 2);
      this.Writer.WriteEndElement();
      this.WriteProperty("Type", "DataTypeVectorWeightedGlobalID", 3);
      this.Writer.WriteEndElement();
      this.Writer.WriteEndElement();
    }

    public override void WriteBody()
    {
    }
  }

  /*
   * MassMotionFloor Class
   */
  class MMFloor : MMObject
  {
    Rhino.Geometry.Mesh _msh;

    //constructor method
    public MMFloor(Rhino.Geometry.Mesh msh, XmlTextWriter writer, string tag)
      : base(writer, tag)
    {
      this._msh = msh;
      this._ObjectSubType = "FloorActor";
      this._Name = this.Mesh.ToString().Replace(".", "_") + this.ObjectSubType + tag;
    }
    // return the mesh geometry of this object
    public Rhino.Geometry.Mesh Mesh { get { return this._msh; }}

    // Write the body element of this object
    public override void WriteBody()
    {
      this.Writer.WriteStartElement("Body");
      this.WriteMeshGeometry(this.Mesh);
      this.Writer.WriteEndElement();
    }
  }

  /*
   * MassMotionBarrier Class
   */
  class MMBarrier : MMObject
  {
    Rhino.Geometry.Mesh _msh;

    //constructor method
    public MMBarrier(Rhino.Geometry.Mesh msh, XmlTextWriter writer, string tag)
      : base(writer, tag)
    {
      this._msh = msh;
      this._ObjectSubType = "BarrierActor";
      this._Name = this.Mesh.ToString().Replace(".", "_") + this.ObjectSubType + tag;
    }
    // return the mesh geometry of this object
    public Rhino.Geometry.Mesh Mesh { get { return this._msh; }}

    // Write the body element of this object
    public override void WriteBody()
    {
      this.Writer.WriteStartElement("Body");
      this.WriteMeshGeometry(this.Mesh);
      this.Writer.WriteEndElement();
    }
  }

  /*
   * MassMotionLink Class
   */
  class MMLink : MMObject
  {
    Rhino.Geometry.Mesh _msh;

    // contructor method
    public MMLink(Rhino.Geometry.Mesh msh, XmlTextWriter writer, string tag)
      : base(writer, tag)
    {
      this._msh = msh;
      this._msh.Translate(new Vector3d(0, 0, 0.05));
      this._ObjectSubType = "LinkActor";
      this._Name = this.Mesh.ToString().Replace(".", "_") + this.ObjectSubType + tag;
    }
    // return the mesh geometry of this object
    public Rhino.Geometry.Mesh Mesh { get { return this._msh; }}

    // Write the body element of this object
    public override void WriteBody()
    {

      this.Writer.WriteStartElement("Body");

      this.Writer.WriteStartElement("Attributes");
      this.WriteAttribute("AttrCEActorGoalPointPositions",
        this.SerializeMeshVertices(this.Mesh), 2,
        "DataTypeVectorDouble", 3);
      this.WriteAttribute("AttrCEActorGoalVertexIndices",
        "[1,3,2,0]", 1,
        "DataTypeVectorInt", 3);
      this.Writer.WriteEndElement();
      this.WriteMeshGeometry(this.Mesh);
      this.Writer.WriteEndElement();
    }
  }
  /*
   * MassMotionPortal Class
   */
  class MMPortal : MMObject
  {
    Rhino.Geometry.Mesh _msh;

    // contructor method
    public MMPortal(Rhino.Geometry.Mesh msh, XmlTextWriter writer, string tag)
      : base(writer, tag)
    {
      this._msh = msh;
      this._msh.Translate(new Vector3d(0, 0, 0.05));
      this._ObjectSubType = "PortalActor";
      this._Name = this.Mesh.ToString().Replace(".", "_") + this.ObjectSubType + tag;
    }
    // return the mesh geometry of this object
    public Rhino.Geometry.Mesh Mesh { get { return this._msh; }}

    // Write the body element of this object
    // This currently is not outputting the correct locations for:
    //  - AttrPortalGoalEdgeIndices and
    //  - AttrPortalGoalPointPositions
    public override void WriteBody()
    {
      this.Writer.WriteStartElement("Body");

      this.Writer.WriteStartElement("Attributes");
      this.WriteAttribute("AttrPortalGoalEdgeIndices",
        "[1,4]", 1,
        "DataTypeVectorInt", 3);
      this.WriteAttribute("AttrPortalGoalPointPositions",
        "temp", 2,
        "DataTypeVectorDouble", 3);
      this.Writer.WriteEndElement();
      this.WriteMeshGeometry(this.Mesh);
      this.Writer.WriteEndElement();
    }
  }

  /*
   * MassMotionPath Class
   */
  class MMPath : MMObject
  {
    Rhino.Geometry.Polyline _pline;

    public MMPath(Rhino.Geometry.Polyline pline, XmlTextWriter writer, string tag)
      : base(writer, tag)
    {
      this._pline = pline;
      this._ObjectSubType = "PathActor";
      this._Name = this.Pline.ToString().Replace(".", "_") + this.ObjectSubType + tag;
    }
    // return the polyline geometry of this object
    public Rhino.Geometry.Polyline Pline { get { return this._pline; }}

    // Write the body element of this object
    public override void WriteBody()
    {
      this.Writer.WriteStartElement("Body");
      this.WritePolyLineGeometry(this.Pline);
      this.Writer.WriteEndElement();
    }
  }

  /*
   * MassMotion VisualizationOnly Class
   */
  class MMVisOnly : MMObject
  {
    Rhino.Geometry.Mesh _msh;

    //constructor method
    public MMVisOnly(Rhino.Geometry.Mesh msh, XmlTextWriter writer, string tag)
      : base(writer, tag)
    {
      this._msh = msh;
      this._ObjectSubType = "VisOnlyActor";
      this._Name = this.Mesh.ToString().Replace(".", "_") + this.ObjectSubType + tag;
    }
    // return the mesh geometry of this object
    public Rhino.Geometry.Mesh Mesh { get { return this._msh; }}

    // Write the body element of this object
    public override void WriteBody()
    {
      this.Writer.WriteStartElement("Body");
      this.WriteMeshGeometry(this.Mesh);
      this.Writer.WriteEndElement();
    }
  }
# ---------- end mass_motion_export ----------
panel_2 = Panel(mass_motion_export.out)
